# Grasshopper definition 01_01_plato.gh (Grasshopper 1.0.7)

pt = Point([<point referenced from the Rhino model> x2])
pt_2 = Point(<point referenced from the Rhino model>)
item = ListItem(List=pt, Index=Slider(12, range=0..100), Wrap=True)
ln = Line(StartPoint=pt, EndPoint=pt_2)
ln_2 = Line(StartPoint=item, EndPoint=pt_2)
dist = Distance(PointA=item, PointB=pt_2)
sph = Sphere(Base=item, Radius=dist)
